# Grasshopper definition GridShellFormFinding_v0.1.gh (Grasshopper 1.0.8)
# plug-ins: MeshEdit Components, Pufferfish, Human, Weaverbird, ShapeDiverForGrasshopper, Kangaroo2 Components

# DIFFERENTIAL
# Grid Shell Form Finding
# Grasshopper script for the form-finding of grid shell structures using Kangaroo2,
# enhanced with the Human plugin for visualization and Weaverbird
# for advanced mesh operations. This script aims to provide an efficient
# and aesthetically pleasing method for creating grid shell forms.
# 
# Requirements:
# Rhino 6 or later with Grasshopper
# - Kangaroo2
# - Human
# - Weaverbird
# 
# We welcome contributions to improve the script!
# If you encounter any issues or have suggestions for enhancements, please feel free to reach out to us.
# Contact us at: hello@differential.works.
# 1. Grid definition
sddp = ShapeDiverDocumentPayload({AbsoluteTolerance=0, AngleTolerance=0, DistanceDisplayPrecision=0, GltfVersion="Gltf2", GrasshopperVersion="1.0.0008", InputGroups="{}", OutputGroups="{}", RelativeTolerance=0, RhinoVersion="8.9.24194.18121", UnitSystem=0, VersionCreated="1.15.0.0", VersionSaved="1.18.1.0"})

grid_size_v = Slider(3000, range=0..10000)
v_grid = Slider(17, range=0..100)
grid_size_u = Slider(4000, range=0..10000)
u_grid = Slider(19, range=0..100)
xy = XYPlane(Origin=Point(0, 0, 0))
X = UnitX(Factor=1)
Y = UnitY(Factor=1)
multiplication = Multiplication(A=grid_size_v, B=v_grid)
multiplication_2 = Multiplication(A=grid_size_u, B=u_grid)
line = LineSDL(Start=xy, Direction=X, Length=multiplication)
line_2 = LineSDL(Start=xy, Direction=Y, Length=multiplication_2)
series = Series(Start=0, Step=grid_size_u, Count=expr("x+1", u_grid))
series_2 = Series(Start=0, Step=grid_size_v, Count=expr("x+1", v_grid))
multiplication_3 = Multiplication(A=series, B=Y)
multiplication_4 = Multiplication(A=series_2, B=X)
move = Move(Geometry=line, Motion=multiplication_3)  # -> Geometry, Transform
move_2 = Move(Geometry=line_2, Motion=multiplication_4)  # -> Geometry, Transform
ccx = CurveCurve(CurveA=graft(move.Geometry), CurveB=move_2.Geometry)  # -> flatten(Points), ParamsA, ParamsB
frompoints = MeshFromPoints(Points=ccx.Points, UDirection=expr("x+1", u_grid), VDirection=expr("x+1", v_grid))

nv = NakedVertices(Mesh=frompoints)  # -> ClothedIndex, NakedIndex, ClothedPts, NakedPts

# ----
# 2. Anchor points
number_slider = Slider(50, range=0..100)
item = ListItem(List=nv.ClothedPts, Index=Slider(503, range=0..1000), Wrap=True)
item_2 = ListItem(List=nv.NakedPts, Index=Slider(17, range=0..100), Wrap=True)
item_3 = ListItem(List=nv.ClothedPts, Index=number_slider, Wrap=True)
cps = ClosestPoints(Point=item, Cloud=nv.ClothedPts, Count=Slider(9, range=0..10))  # -> ClosestPoint, CPIndex, Distance

# ----
# 3. Goal objects
show = Show(G=frompoints)
anchorxyz = AnchorXYZ(Point=nv.NakedPts, X=True, Y=True, Z=False, Strength=1)
edgelengths = EdgeLengths(Mesh=frompoints, LengthFactor=1, Strength=1)
vertexloads = VertexLoads(Mesh=frompoints, Strength=Slider(5, range=0..10))
anchor = Anchor(Point=flatten([item_3, cps.ClosestPoint, item_2]), Strength=10000)

entwine = Entwine(Branch00=show, Branch01=anchorxyz, Branch02=edgelengths, Branch03=vertexloads, Branch04=anchor, FlattenInputs=True)

# ---- group: ANIMATE
number_slider_2 = Slider(100, range=0..100)

# ----
# Combine animate and degrees sliders if you want them to rotate together
number_slider_3 = Slider(0, range=0..180)

# ----
# 4. Solver
number_slider_4 = Slider(1, range=0..1)
stepsolver = StepSolver(GoalObjects=entwine, Tolerance=number_slider_4, Momentum=True, Damping=0.99, SubIterations=7, Animate=number_slider_2)  # -> I, V, O

item_4 = ListItem(List=stepsolver.O, Index=0, Wrap=True)

# ---- group: Rotation for the animation purpose
rad = Radians(Degrees=number_slider_3)
area = Area(Geometry=frompoints)  # -> Area, Centroid
mesh = Mesh(item_4)
rotate = Rotate(Geometry=mesh, Angle=rad, Plane=area.Centroid)  # -> Geometry, Transform

# ---- group: Grid shell frames
# Gridshell frames
diag = Diagonalize(Mesh=rotate.Geometry)
faceb = FaceBoundaries(Mesh=diag)
facen = FaceNormals(Mesh=diag)  # -> graft(Centers), Normals
explode = Explode(Curve=faceb, Recursive=True)  # -> Segments, Vertices
pdecon = Deconstruct(Point=explode.Vertices)  # -> XComponent, YComponent, ZComponent
planar = Planar(Curve=faceb)  # -> Planar, Plane, Deviation
sort = SortList(Keys=pdecon.ZComponent, ValuesA=explode.Vertices)  # -> Keys, ValuesA
deplane = DeconstructPlane(Plane=graft(planar.Plane))  # -> Origin, XAxis, YAxis, ZAxis
item_5 = ListItem(List=sort.ValuesA, Index=0, Wrap=True)
pl = ConstructPlane(Origin=facen.Centers, XAxis=deplane.XAxis, YAxis=deplane.YAxis)
projecta = ProjectAlong(Geometry=graft(faceb), Plane=pl, Direction=Vector(0, 0, -1))  # -> Geometry, Transform
project = Project(Geometry=graft(faceb), Plane=pl)  # -> Geometry, Transform
number_slider_5 = Slider(20, range=0..100)
explode_2 = Explode(Curve=projecta.Geometry, Recursive=True)  # -> Segments, Vertices
wbweave = WeaverbirdsMeshFromLinesWeaveBack(Lines=explode_2.Segments, MaximumValence=4)
wbwindow = WeaverbirdsMeshWindow(MeshPolylines=wbweave, Distance=number_slider_5, InsetType=1)
wbframe = WeaverbirdsPictureFrame(MeshPolylines=wbweave, Distance=number_slider_5, InsetType=1)

# ----
facen_2 = FaceNormals(Mesh=rotate.Geometry)  # -> Centers, Normals
mesh_2 = Mesh(frompoints)
pdecon_2 = Deconstruct(Point=facen_2.Centers)  # -> XComponent, YComponent, ZComponent
rotate_2 = Rotate(Geometry=mesh_2, Angle=rad, Plane=area.Centroid)  # -> Geometry, Transform
sort_2 = SortList(Keys=flatten(pdecon_2.ZComponent), ValuesA=flatten(facen_2.Centers))  # -> reverse(Keys), reverse(ValuesA)
medges = MeshEdges(Mesh=rotate_2.Geometry)  # -> NakedEdges, InteriorEdges, NonManifoldEdges
item_6 = ListItem(List=sort_2.Keys, Index=0, Wrap=True)
item_7 = ListItem(List=sort_2.ValuesA, Index=0, Wrap=True)

# ---- group: Unify panel normals
facen_3 = FaceNormals(Mesh=wbwindow)  # -> Centers, Normals
pdecon_3 = Deconstruct(Point=facen_3.Centers)  # -> XComponent, YComponent, ZComponent
line_3 = LineSDL(Start=facen_3.Centers, Direction=facen_3.Normals, Length=1000)
end = EndPoints(Curve=line_3)  # -> Start, End
pt = Point(end.End)
pdecon_4 = Deconstruct(Point=pt)  # -> XComponent, YComponent, ZComponent
smaller = SmallerThan(FirstNumber=pdecon_4.ZComponent, SecondNumber=pdecon_3.ZComponent)  # -> SmallerThan, OrEqualTo
dispatch = Dispatch(List=wbwindow, DispatchPattern=smaller.SmallerThan)  # -> ListA, ListB
mesh_3 = Mesh(dispatch.ListA)
mesh_4 = Mesh(dispatch.ListB)
flipm = FlipMesh(Mesh=mesh_3, VertexNormals=True, FaceNormals=True, FaceOrientation=True)
merge = Merge(Data1=flipm, Data2=mesh_4)

# ----
curvepoint = PointOnCurve(medges.InteriorEdges, parameter=0.5)
swatch = ColourSwatch(SwatchColor=RGB(0, 0, 0))
scale = Scale(Geometry=medges.InteriorEdges, Center=curvepoint, Factor=0.8)  # -> Geometry, Transform

Z = UnitZ(Factor=item_6)
move_3 = Move(Geometry=medges.NakedEdges, Motion=Z)  # -> Geometry, Transform
join = JoinCurves(Curves=move_3.Geometry, Preserve=False)
simplify = SimplifyCurve(Curve=join)  # -> Curve, Simplified
explode_3 = Explode(Curve=simplify.Curve, Recursive=True)  # -> Segments, Vertices
Z_2 = UnitZ(Factor=-1)
line_4 = LineSDL(Start=explode_3.Vertices, Direction=Z_2, Length=item_6)

# ---- group: highest point preview
number_slider_6 = Slider(200, range=0..1000)
Z_3 = UnitZ(Factor=number_slider_6)
move_4 = Move(Geometry=item_7, Motion=Z_3)  # -> Geometry, Transform
sph = Sphere(Base=move_4.Geometry, Radius=number_slider_6)
preview = CustomPreview(Geometry=sph, Material=ColourSwatch(SwatchColor=RGB(0, 0, 0)))

number_slider_7 = Slider(8000, range=0..10000)
Z_4 = UnitZ(Factor=number_slider_7)
move_5 = Move(Geometry=item_7, Motion=Z_4)  # -> Geometry, Transform
line_5 = LineSDL(Start=item_7, Direction=Z_4, Length=number_slider_7)

# 5. Preview
# Grid preview
round = Round(Number=item_6)  # -> Nearest, Floor, Ceiling
join_2 = TextJoin(Text=flatten([round.Nearest, "mm"]))
join_3 = TextJoin(Text=flatten(["H= ", join_2]))
screentext = ScreenOrientedText(
    Text=join_3,
    Font="Neue Pixel Grotesk",
    Justification=8,
    Location=move_5.Geometry,
    SizeFactor=Slider(15, range=0..100),
    Depth=0,
    Absolute=False)

# ----
unifynormals = MeshUnifyNormals(Mesh=wbwindow)

previewlw = CustomPreviewLineweights(Geometry=medges.NakedEdges, Shader=swatch, Thickness=Slider(3, range=0..10), Absolute=False)
previewlw_2 = CustomPreviewLineweights(
    Geometry=[scale.Geometry, move_3.Geometry, line_4, line_5],
    Shader=swatch,
    Thickness=Slider(1, range=0..10),
    Absolute=False)

# ---- group: Preview grid shell
Z_5 = UnitZ(Factor=-450)
material = MaterialShiny(
    Color_Diffuse=ColourSwatch(SwatchColor=RGB(122, 122, 122)),
    Color_Ambient=ColourSwatch(SwatchColor=RGB(143, 177, 194)),
    Reflection=Slider(1, range=0..1),
    Smoothness=Slider(0.12, range=0..1),
    Transparency=Slider(0.149, range=0..1))  # -> out, Mat; inputs Color_Diffuse: Color, Color_Ambient: Color, Color_Emission: Color, Reflection: Double, Smoothness: Double, Transparency: Double
# ---------- material: C# usings ----------
using System.Drawing;
# ---------- material: C# ----------
    Reflection = Math.Min(Math.Max(Reflection, 0), 1);
    Smoothness = Math.Min(Math.Max(Smoothness, 0), 1);
    Transparency = Math.Min(Math.Max(Transparency, 0), 1);

    Rhino.DocObjects.Material material = new  Rhino.DocObjects.Material();
    //material.SetBitmapTexture(fileName);
    material.ReflectionColor = Color_Diffuse;
    material.DiffuseColor = Color_Diffuse;
    material.AmbientColor = (Color) Color_Ambient;
    material.EmissionColor = (Color) Color_Emission;
    material.Reflectivity = Reflection;
    material.ReflectionGlossiness = Smoothness;
    material.Transparency = Transparency;

    var renderMaterial = Rhino.Render.RenderMaterial.CreateBasicMaterial(material);
    Mat = new GH_Material(renderMaterial);
# ---------- end material ----------
paramextrmsh = ParameterExtrudeMesh(
    Profile=explode_2.Segments,
    Direction=Z_5,
    ParametersU=[0, 1],
    ParametersV=[0, 1],
    Weighted=False,
    Lengths=False,
    Angle=0,
    Cap=False,
    Triangulate=False,
    WeightedV=False,
    LengthsV=False,
    AngleV=0)
material_2 = CreateMaterial(Diffuse=RGB(66, 66, 66), Specular=RGB(255, 255, 255), Emission=RGB(0, 0, 0), Transparency=0, Shine=30)
preview_2 = CustomPreview(Geometry=paramextrmsh, Material=material_2)
preview_3 = CustomPreview(Geometry=wbframe, Material=ColourSwatch(SwatchColor=RGB(0, 0, 0)))
preview_4 = CustomPreview(Geometry=merge, Material=material.Mat)
